# Grasshopper definition 3_7_23_robot-rooms-fins-with-comments.gh (Grasshopper 1.0.7)
# plug-ins: Pufferfish

# Line used to set dimension for X
number_slider = Slider(35, range=0..100)
# Line used to set linear dimension for Y
crv = Curve(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)
X = UnitX(Factor=number_slider)
number_slider_2 = Slider(4, range=1..12)
# Number of Divisions (number of fins = number of  divisions - 1)
move = Move(Geometry=crv, Motion=X)  # -> Geometry, Transform
divide = DivideCurve(Curve=move.Geometry, Count=number_slider_2, Kinks=False)  # -> Points, Tangents, Parameters
divide_2 = DivideCurve(Curve=crv, Count=number_slider_2, Kinks=False)  # -> Points, Tangents, Parameters
ln = Line(StartPoint=divide_2.Points, EndPoint=divide.Points)
# Units for length of fins (in inches)
number_slider_3 = Slider(10, range=1..24)
# Dispatch curves from list to make two subsets.
dispatch = Dispatch(List=ln, DispatchPattern=[True, False])  # -> ListA, ListB
crv_2 = Curve(dispatch.ListA)
crv_3 = Curve(dispatch.ListB)
Z = UnitZ(Factor=number_slider_3)
Z_2 = UnitZ(Factor=Slider(15, range=1..24))
extr = Extrude(Base=crv_2, Direction=Z)
extr_2 = Extrude(Base=crv_3, Direction=Z_2)
# Use this definition if you want all the fins to be uniform in size and direction
Z_3 = UnitZ(Factor=Slider(6, range=1..12))
# Rotation of fins around the axes (in radians)
number_slider_4 = Slider(0.24, range=-2..6.5)
extr_3 = Extrude(Base=ln, Direction=Z_3)
neg = Negative(Value=number_slider_4)
rotax = RotateAxis(Geometry=extr_2, Angle=neg, Axis=crv_3)  # -> Geometry, Transform
rotax_2 = RotateAxis(Geometry=extr, Angle=number_slider_4, Axis=crv_2)  # -> Geometry, Transform
rotax_3 = RotateAxis(Geometry=extr_3, Angle=Slider(2.45, range=0.01..6.5), Axis=ln)  # -> Geometry, Transform
edges = BrepEdges(Brep=rotax_2.Geometry)  # -> Naked, Interior, NonManifold
edges_2 = BrepEdges(Brep=rotax.Geometry)  # -> Naked, Interior, NonManifold
crv_4 = Curve(edges.Naked)
crv_5 = Curve(edges_2.Naked)
explode = Explode(Curve=crv_4, Recursive=True)  # -> flatten(Segments), Vertices
explode_2 = Explode(Curve=crv_5, Recursive=True)  # -> flatten(Segments), Vertices
dispatch_2 = Dispatch(List=explode.Segments, DispatchPattern=[True, False])  # -> ListA, ListB
dispatch_3 = Dispatch(List=explode_2.Segments, DispatchPattern=[True, False])  # -> ListA, ListB
crv_6 = Curve(dispatch_2.ListB)
crv_7 = Curve(dispatch_3.ListB)
dispatch_4 = Dispatch(List=crv_6, DispatchPattern=[True, False])  # -> ListA, ListB
dispatch_5 = Dispatch(List=crv_7, DispatchPattern=[True, False])  # -> ListA, ListB
crv_8 = Curve(flatten(dispatch_5.ListA))
crv_9 = Curve(flatten(dispatch_4.ListA))
end = EndPoints(Curve=crv_9)  # -> Start, End
end_2 = EndPoints(Curve=crv_8)  # -> Start, End
weave = Weave(Pattern=[0, 1], Stream0=end.Start, Stream1=end_2.Start, NullGaps=False)
pt = Point(weave)
intcrv = Interpolate(Vertices=pt, Degree=3, Periodic=False, KnotStyle=1)  # -> Curve, Length, Domain
# Thickness of the top surface (in inches)
number_slider_5 = Slider(2.06, range=0.01..5)
# Length of line used to make top surface (in inches)
panel = Panel(intcrv.Length)
extr_4 = Extrude(Base=intcrv.Curve, Direction=X)
offsrf = OffsetSurface(Surface=extr_4, Distance=number_slider_5, BothSides=0, CreateSolid=True)
colour = ColourPicker(PickedColour=RGB(178, 194, 190))
# Material Color Picker
preview = CustomPreview(Geometry=offsrf, Material=colour)
