# Grasshopper definition Hinges_angle-dims.gh (Grasshopper 1.0.7)
# plug-ins: Kangaroo2 Components

crv = Curve(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)
crv_2 = Curve(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)
crv_3 = Curve(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)
cp = ControlPoints(Curve=crv_3)  # -> Points, Weights, Knots
pline = PolyLine(Vertices=cp.Points, Closed=False)
pt = ConstructPoint(XCoordinate=Slider(0, range=0..100), YCoordinate=Slider(0, range=0..10), ZCoordinate=Slider(39, range=-66..76))
explode = Explode(Curve=pline, Recursive=True)  # -> Segments, Vertices
end = EndPoints(Curve=pline)  # -> Start, End
pt_2 = ConstructPoint(XCoordinate=Slider(67, range=-50..200), YCoordinate=Slider(0, range=0..11), ZCoordinate=Slider(0, range=0..100))
move = Move(Geometry=end.Start, Motion=pt)  # -> Geometry, Transform
move_2 = Move(Geometry=end.End, Motion=pt_2)  # -> Geometry, Transform
anchor = Anchor(Point=end.Start, Strength=10000)
length_line = LengthLine(Line=explode.Segments, Strength=10)
anchor_2 = Anchor(Point=end.Start, Target=move.Geometry, Strength=10000)
anchor_3 = Anchor(Point=end.End, Target=move_2.Geometry, Strength=10000)
anchor_4 = Anchor(Point=end.End, Strength=10000)
show = Show(G=pline)
rod = Rod(Polyline=pline, LengthFactor=1, AngleFactor=Slider(0.1, range=0.1..1.1), AxialStrength=10, BendStrength=1)
merge = Merge(
    Data1=flatten(show),
    Data2=flatten(anchor),
    Data3=flatten(anchor_2),
    Data4=flatten(anchor_4),
    Data5=flatten(anchor_3),
    Data6=flatten(rod),
    Data7=flatten(length_line))
solver = Solver(GoalObjects=merge, Reset=Button(), Threshold=1e-15, Tolerance=0.0001, On=Toggle(True))  # -> I, V, O
panel = Panel("""CURVE_1: INDEX_9

CURVE_2: INDEX_5""")
crv_4 = Curve(solver.O)
cp_2 = ControlPoints(Curve=crv_4)  # -> flatten(Points), Weights, Knots
split = SplitList(List=cp_2.Points, Index=Slider(5, range=0..9))  # -> ListA, ListB
pline_2 = PolyLine(Vertices=split.ListA, Closed=False)
crv_5 = Curve(pline_2)
end_2 = EndPoints(Curve=pline_2)  # -> Start, End
explode_2 = Explode(Curve=pline_2, Recursive=True)  # -> Segments, Vertices
vec = VectorXYZ(XComponent=Slider(0, range=0..1), YComponent=Slider(1, range=0..1), ZComponent=Slider(0, range=0..1))  # -> Vector, Length
offset = OffsetCurve(Curve=crv_5, Distance=Slider(-2, range=-2..0), Corners=1)
pl = PlaneNormal(Origin=end_2.Start, ZAxis=vec.Vector)
item = ListItem(List=explode_2.Segments, Index=Slider(0, range=0..100), Wrap=True)  # -> Item, Item1, Item2, Item3
offset_2 = OffsetCurve(Curve=pline_2, Distance=Slider(4.5, range=1..5), Plane=pl, Corners=1)
crv_6 = Curve(pline_2)
offset_3 = OffsetCurve(Curve=offset, Distance=Slider(-2, range=-2..5), Plane=pl, Corners=1)
crv_7 = Curve(item.Item2)
crv_8 = Curve(item.Item3)
crv_9 = Curve(item.Item1)
crv_10 = Curve(item.Item1)
crv_11 = Curve(item.Item)
crv_12 = Curve(offset_2)
crv_13 = Curve(offset_3)
end_3 = EndPoints(Curve=crv_6)  # -> Start, End
end_4 = EndPoints(Curve=crv_12)  # -> Start, End
flip = FlipCurve(Curve=crv_8)  # -> Curve, Flag
flip_2 = FlipCurve(Curve=crv_9)  # -> Curve, Flag
flip_3 = FlipCurve(Curve=crv_10)  # -> Curve, Flag
end_5 = EndPoints(Curve=offset)  # -> Start, End
end_6 = EndPoints(Curve=crv_13)  # -> Start, End
ln = Line(StartPoint=end_4.Start, EndPoint=end_3.Start)
ln_2 = Line(StartPoint=end_4.End, EndPoint=end_3.End)
vec_2 = VectorXYZ(XComponent="0", YComponent="1", ZComponent="0")  # -> Vector, Length
ln_3 = Line(StartPoint=end_6.Start, EndPoint=end_5.Start)
ln_4 = Line(StartPoint=end_6.End, EndPoint=end_5.End)
join = JoinCurves(Curves=flatten([ln, ln_2, crv_12, crv_6]), Preserve=False)
pl_2 = PlaneNormal(Origin=end_2.Start, ZAxis=vec_2.Vector)
crv_14 = Curve(join)
join_2 = JoinCurves(Curves=flatten([offset, crv_13, ln_3, ln_4]), Preserve=False)
cp_3 = ControlPoints(Curve=crv_14)  # -> flatten(Points), Weights, Knots
angle = Angle(VectorA=crv_11, VectorB=flip_3.Curve, Plane=pl_2)  # -> Angle, Reflex
angle_2 = Angle(VectorA=flip_2.Curve, VectorB=crv_7, Plane=pl_2)  # -> Angle, Reflex
angle_3 = Angle(VectorA=crv_7, VectorB=flip.Curve, Plane=pl_2)  # -> Angle, Reflex
crv_15 = Curve(join_2)
deg = Degrees(Radians=[angle.Angle, angle_2.Angle, angle_3.Angle])
nurbs = NurbsCurve(Vertices=cp_3.Points, Degree=Slider(2, range=1..3), Periodic=Toggle(True))  # -> Curve, Length, Domain
Y = UnitY(Factor=Slider(24, range=1..24))
Y_2 = UnitY(Factor=Slider(22, range=1..24))
panel_2 = Panel(deg)
extr = Extrude(Base=nurbs.Curve, Direction=Y)
extr_2 = Extrude(Base=crv_15, Direction=Y_2)
colour = ColourPicker(PickedColour=RGB(130, 130, 130))
num = Number("1")
cap = CapHoles(Brep=extr)
cap_2 = CapHoles(Brep=extr_2)
Y_3 = UnitY(Factor=num)
move_3 = Move(Geometry=cap_2, Motion=Y_3)  # -> Geometry, Transform
brep = Brep(cap)
brep_2 = Brep(move_3.Geometry)
colour_2 = ColourPicker(PickedColour=RGB(69, 69, 69))
preview = CustomPreview(Geometry=brep_2, Material=colour_2)
preview_2 = CustomPreview(Geometry=brep, Material=colour)
